vi "EnableWordEdit.gvi"   [LabVIEW NXG 3.1.0]
inputs:
  "Array of Control References": "Control reference"[]
  "Enable?": bool
  "Error In": error
outputs:
  "Error Out": error
  "Array of Control References Out": "Control reference"[]
uses:
  NI::G Core::Error::Display Error.gvi
  NI::G Core::Error::Clear Error Cluster.gvi
diagram:
  Not(x=$"Enable?") -> w1
  case ($"Error In") {
    frame Error, Default {
      w2 = $"Error In"
      w3 = $"Array of Control References"
    }
    frame No Error {
      s1 = $"Error In"  # shift register
      for {
        w4 = each element of $"Array of Control References"
        Property Node(instance in=w4, "Disabled"=w1, error in=s1) -> (error out=w5, instance out=w6)
        call "Display Error.gvi"(error in=w5, type of dialog="continue or stop message")
        call "Clear Error Cluster.gvi"(error in=w5) -> (error out=w7)
        append w6 to w3
        next s1 = w7
      }
      w2 = s1
    }
  }
  $"Array of Control References Out" <- w3
  $"Error Out" <- w2
