vi "InitVocabArray.gvi"   [LabVIEW NXG 3.1.0]
inputs:
  "text from File": string
  "Error In": error
outputs:
  "VocabArray": "VocabWord.gtype"[]
  "Error Out": error
uses:
  NI::G Core::Error::Clear Error Cluster.gvi
  NI::G Core::Error::Display Error.gvi
diagram:
  # todo: error handling when remainder is non zero...
  case ($"Error In") {
    frame Error, Default {
      w1 = "VocabWord.gtype"[] []
      w2 = $"Error In"
    }
    frame No Error {
      Spreadsheet String To Array(array type=string[] [], delimiter=",", format string="%s", spreadsheet string=$"text from File") -> (array=w3)
      Array Size(array=w3) -> (size(s)=w4)
      Quotient And Remainder(x=w4, y=3) -> (floor(x/y)=w5)
      s1 = w3  # shift register
      s2 = "VocabWord.gtype"[] []  # shift register
      s3 = $"Error In"  # shift register
      for (N = w5) {
        Delete From Array(inArray=s1, length (1)=3, index0=0) -> (outArray=w6, deleted=w7)
        Array Index(array=w7) -> (out0[_]=w8, out1[_]=w9, out2[_]=w10)
        Property Node(instance in="VocabWord.gtype" constant, "Word"=w8, "Definition"=w9, "Resource Link"=w10, error in=s3) -> (error out=w11, instance out=w12)
        Insert Into Array(inArray=s2, new=w12) -> w13
        call "Clear Error Cluster.gvi"(error in=w11) -> (error out=w14)
        call "Display Error.gvi"(error in=w11)
        next s1 = w6
        next s2 = w13
        next s3 = w14
      }
      w1 = s2
      w2 = s3
    }
  }
  $"Error Out" <- w2
  $VocabArray <- w1
