vi "Main.gvi"   [LabVIEW NXG 3.1.0]
panel controls:
  "Stop": bool
  "Open Link": bool
  "Word Index": i32
  "Random Word": bool
  "Save": bool
  "Definition": string
  "Word": string
  "Resource Link": string
  "Insert Word": bool
panel indicators:
  "# Vocab Words Stored": i32
  "Header (Current Mode)": string
types:
  "StateData.gtype" = cluster{"Vocab Words": "VocabWord.gtype"[], "Word Controls": "Control reference"[], "CSV Path": path}
uses:
  NI::G Core::URL::Open URL in Default Browser (string).gvi
  NI::G Core::Error::Display Error.gvi
  NI::G Core::Error::Clear Error Cluster.gvi
  NI::G Core::Numeric::Random Number (Range) DBL.gvi
diagram:
  w1 = "Init"  # Program State
  w2 = no error  # Error
  s1 = w1  # shift register
  s2 = w2  # shift register
  s3 = "StateData.gtype" {all zero or empty}  # shift register
  while {
    # s1: State
    # w3: State
    # w4: Close?
    case (s2) {
      frame Error, Default {
        Property Node(instance in=s2) -> ("source"=w7, "code"=w8)
        Format Into String(initString="(Error %d) - %s \\n\\n The program will now close.", w8, w7) -> w9
        One Button Dialog(message=w9) -> (true=w4)
        w5 = s3
        w3 = s1
        w6 = s2
      }
      frame No Error {
        case (s1) {
          frame "Init" {
            $"Header (Current Mode)" <- "Manual Mode"
            Build Array(reference to "Word", reference to "Definition", reference to "Resource Link", reference to "Save") -> w10
            call "EnableWordEdit.gvi"(Array of Control References=w10, Enable?=FALSE, Error In=s2) -> (Array of Control References Out=w11, Error Out=w12)
            Get Component Directory() -> (Path=w13)
            Build Path(base path=w13, name or relative path=path "VocabWords.csv") -> (appended path=w14)
            Open Or Create Or Replace File(error in=w12, file path (use dialog)=w14, operation (0:open)="open or create") -> (error out=w15, refnum out=w16)
            Read From Text File(error in=w15, file (use dialog)=w16) -> (error out=w17, refnum out=w18, text=w19)
            Close File(error in=w17, refnum=w18) -> (error out=w20, path=w21)
            call "InitVocabArray.gvi"(text from File=w19, Error In=w20) -> (VocabArray=w22, Error Out=w23)
            Property Node(instance in=s3, "Vocab Words"=w22, "Word Controls"=w11, "CSV Path"=w21) -> (instance out=w5)
            w24 = "Wait For Event"  # Program State
            Array Size(array=w22) -> (size(s)=w25)
            $"# Vocab Words Stored" <- w25
            Is Greater Than 0(x=w25) -> w26
            case (w26) {
              frame False, Default {
                $Definition <- ""
                $"Resource Link" <- ""
                $Word <- "Insert a vocab word to get started!"
                w6 = w23
              }
              frame True {
                Array Index(array=w22) -> (out0[$"Word Index"]=w27)
                Property Node(instance in=w27, error in=w23) -> ("Word"=w28, "Definition"=w29, "Resource Link"=w30, error out=w6)
                $"Resource Link" <- w30
                $Word <- w28
                $Definition <- w29
              }
            }
            w3 = w24
            w4 = FALSE
          }
          frame "Wait For Event", Default {
            event (after s1) {
              on "Word Index" Value changed {
                $"Header (Current Mode)" <- "Manual Mode"
                w31 = "Wait For Event"  # Program State
                Property Node(instance in=s3) -> ("Vocab Words"=w32, "Word Controls"=w33, instance out=w5)
                call "EnableWordEdit.gvi"(Array of Control References=w33, Enable?=FALSE, Error In=s2) -> (Error Out=w34)
                Array Size(array=w32) -> (size(s)=w35)
                Is Greater Than 0(x=w35) -> w36
                case (w36) {
                  frame False, Default {
                    $Word <- "Insert a vocab word to get started!"
                    w6 = w34
                  }
                  frame True {
                    Array Index(array=w32) -> (out0[$"Word Index"]=w37)
                    Property Node(instance in=w37, error in=w34) -> ("Word"=w38, "Definition"=w39, "Resource Link"=w40, error out=w6)
                    $Word <- w38
                    $Definition <- w39
                    $"Resource Link" <- w40
                  }
                }
                w3 = w31
                w4 = FALSE
              }
              on "Stop" Value changed {
                Event Data() -> ("Old Value"=w41, "New Value"=w4)
                $Stop <- w41
                w42 = "Exit"  # Program State
                $"Header (Current Mode)" <- "Program stopping..."
                w3 = w42
                w6 = s2
                w5 = s3
              }
              on "Save" Value changed {
                w43 = "Insert"  # Program State
                $"Header (Current Mode)" <- "Saving new word..."
                Event Data() -> ("Old Value"=w44)
                $Save <- w44
                w3 = w43
                w6 = s2
                w5 = s3
                w4 = FALSE
              }
              on "Random Word" Value changed {
                $"Header (Current Mode)" <- "Random Mode"
                Event Data() -> ("Old Value"=w45)
                $"Random Word" <- w45
                w3 = "Random"
                w6 = s2
                w5 = s3
                w4 = FALSE
              }
              on "Insert Word" Value changed {
                $"Resource Link" <- ""
                $Word <- ""
                $Definition <- ""
                Property Node(instance in=s3) -> ("Word Controls"=w46)
                call "EnableWordEdit.gvi"(Array of Control References=w46, Enable?=TRUE, Error In=s2) -> (Error Out=w47)
                Property Node(instance in=reference to "Word", "KeyFocus"=TRUE, error in=w47) -> (error out=w48, instance out=w49)
                Close Reference(error in=w48, reference=w49) -> (error out=w6)
                $"Header (Current Mode)" <- "Insert Mode"
                Event Data() -> ("Old Value"=w50)
                $"Insert Word" <- w50
                w3 = "Wait For Event"
                w5 = s3
                w4 = FALSE
              }
              on "Open Link" Value changed {
                Event Data() -> ("Old Value"=w51)
                $"Open Link" <- w51
                call "Open URL in Default Browser (string).gvi"(URL=$"Resource Link", error in=s2) -> (error out=w52)
                call "Display Error.gvi"(error in=w52)
                # #todo - Either NXG or Brave is adding %2520 instead of
                # just %20 for spaces...
                call "Clear Error Cluster.gvi"(error in=w52) -> (error out=w6)
                w3 = "Wait For Event"
                w5 = s3
                w4 = FALSE
              }
            }
          }
          frame "Random" {
            Property Node(instance in=s3) -> ("Vocab Words"=w53)
            Array Size(array=w53) -> (size(s)=w54)
            Is Greater Than 0(x=w54) -> w55
            case (w55) {
              frame False, Default {
                w6 = s2
              }
              frame True {
                call "Random Number (Range) DBL.gvi"(upper bound=w54, lower bound=0) -> (number=w56)
                Round To Nearest(number=w56) -> w57
                To Long Integer(number=w57) -> w58
                Property Node(instance in=reference to "Word Index", "Value"=w58, error in=s2) -> (error out=w59)
                Array Index(array=w53) -> (out0[w58]=w60)
                Property Node(instance in=w60, error in=w59) -> ("Word"=w61, "Definition"=w62, "Resource Link"=w63, error out=w6)
                $Word <- w61
                $Definition <- w62
                $"Resource Link" <- w63
              }
            }
            w64 = "Wait For Event"  # Program State
            w3 = w64
            w4 = FALSE
            w5 = s3
          }
          frame "Insert" {
            w65 = "Wait For Event"  # Program State
            Is Empty String Or Path(string/path=$Word) -> w66
            Is Empty String Or Path(string/path=$Definition) -> w67
            Is Empty String Or Path(string/path=$"Resource Link") -> w68
            Logical Or(w66, w67, w68) -> w69
            case (w69) {
              frame True {
                $"Header (Current Mode)" <- "Insert Mode"
                w70 = "Please enter a value for all fields: \"Word\", \"Definition\", and \"Resource Link\" before saving."
                One Button Dialog(message=w70)
                w6 = s2
                w5 = s3
              }
              frame False {
                $"Header (Current Mode)" <- "Manual Mode"
                Property Node(instance in=s3) -> ("CSV Path"=w71, "Vocab Words"=w72, instance out=w73)
                Array Size(array=w72) -> (size(s)=w74)
                Is Equal To 0(x=w74) -> w75
                Select(s=w75, t="", f=",") -> w76
                Open Or Create Or Replace File(error in=s2, file path (use dialog)=w71) -> (error out=w77, refnum out=w78)
                Read From Text File(error in=w77, file (use dialog)=w78) -> (error out=w79, refnum out=w80, text=w81)
                Concatenate Strings(w81, w76, $Word, ",", $Definition, ",", $"Resource Link") -> w82
                call "InitVocabArray.gvi"(text from File=w82) -> (VocabArray=w83)
                Property Node(instance in=w73, "Vocab Words"=w83) -> (instance out=w5)
                Array Size(array=w83) -> (size(s)=w84)
                Decrement(x=w84) -> w85
                Array Index(array=w83) -> (out0[w85]=w86)
                Property Node(instance in=w86) -> ("Word"=w87, "Definition"=w88, "Resource Link"=w89)
                $Word <- w87
                $Definition <- w88
                $"Resource Link" <- w89
                Write To Text File(error in=w79, file (use dialog)=w80, text=w82) -> (error out=w90, refnum out=w91)
                Close File(error in=w90, refnum=w91) -> (error out=w6)
                $"# Vocab Words Stored" <- w84
              }
            }
            w3 = w65
            w4 = FALSE
          }
          frame "Exit" {
            w92 = "Exit"  # Program State
            w6 = s2
            w3 = w92
            w4 = TRUE
            w5 = s3
          }
        }
      }
    }
    next s1 = w3
    next s2 = w6
    next s3 = w5
    stop if w4
  }
